# Dynamo custom node v_RotateViewPlan.dyf (Dynamo 2.6.1.8786)
# category: v-nodes.Test
# packages: Rhythm 2021.4.2

view_plan = Input(view_plan: var)
rotation_curve = Input(rotation_curve: var)
angle = Input(angle: var)
degreesToRadians = Math.DegreesToRadians(degrees=angle)
code_block = CodeBlock(a=view_plan, b=rotation_curve, c=degreesToRadians) { [a,b,c]; }
end = Revit.Transaction.Transaction.End(input=code_block)
code_block_2 = CodeBlock(a=end) { a[0]; a[1]; a[2]; }
ʳʰʸᵗʰᵐ_viewplan_rotate = Rhythm.Revit.Views.ViewPlan.Rotate(viewPlan=code_block_2.out0, rotationLine=code_block_2.out1, inputAngle=code_block_2.out2)
crop_box = Output(ʳʰʸᵗʰᵐ_viewplan_rotate)
