# Dynamo custom node v_RotateViewsInModel.dyf (Dynamo 2.6.1.8786)
# category: v-nodes.Test
# packages: archi-lab.net 2021.25.2721

views = Input(views: var[])

# group: LQC CreateLineFromCropRegionOnViews
python_script = Python(IN[0]=views)
# ---------- python_script.python (36 lines) ----------
import clr
clr.AddReference('ProtoGeometry')
from Autodesk.DesignScript.Geometry import *

import clr

clr.AddReference("RevitNodes")
import Revit

# Import ToProtoType, ToRevitType geometry conversion extension methods
clr.ImportExtensions(Revit.GeometryConversion)

#The inputs to this node will be stored as a list in the IN variables.
if isinstance(IN[0], list):
	view = UnwrapElement(IN[0])
	toggle = 0
else:
 view = [UnwrapElement(IN[0])]
 toggle = 1
	
listout = []
for x in view:
 region = x.GetCropRegionShapeManager().GetCropShape()
 if len(region) > 0:
	lines = [y.ToProtoType() for y in region[0]]
	listout.append(lines)
 else:
	listout.append([])



#Assign your output to the OUT variable.
 if toggle == 0:
	OUT = listout
 else:
	OUT = lines
# ----------------------------------------

startPoint = Curve.StartPoint(curve=python_script)
byPoints = Polygon.ByPoints(points=startPoint)
center = Polygon.Center(polygon=byPoints)
angle = Input(angle: var[])
code_block = CodeBlock(a=angle) { -a; Vector.ZAxis(); 1; }
byOriginNormal = Plane.ByOriginNormal(origin=center, normal=code_block.out1)
rotate = Geometry.Rotate(geometry=byPoints, basePlane=byOriginNormal, degrees=code_block.out0)
explode = Geometry.Explode(geometry=rotate)

# group: archi-lab
setCropBoxByCurves = archilab.Revit.Views.Views.SetCropBoxByCurves(view=views, curves=explode)

byStartPointDirectionLength = Line.ByStartPointDirectionLength(startPoint=center, direction=code_block.out1, length=code_block.out2)
byCurve = ModelCurve.ByCurve(curve=byStartPointDirectionLength)

# group: v-test
v_RotateViewPlan = Custom[v_RotateViewPlan](view_plan=setCropBoxByCurves, rotation_curve=byCurve, angle=angle)
