# Dynamo custom node v_repRoomTags.dyf (Dynamo 2.6.1.8786)
# category: v-nodes.Test

rt = Input(rt: Revit.Elements.Element[])
type = Input(type: Revit.Elements.Element)
python_script = Python(IN[0]=rt, IN[1]=type)
# ---------- python_script.python (28 lines) ----------
import clr
clr.AddReference('RevitAPI')
from Autodesk.Revit.DB import *

clr.AddReference("RevitNodes")
import Revit
clr.ImportExtensions(Revit.Elements)

clr.AddReference("RevitServices")
import RevitServices
from RevitServices.Persistence import DocumentManager
from RevitServices.Transactions import TransactionManager

doc = DocumentManager.Instance.CurrentDBDocument
faminsts = UnwrapElement(IN[0])
famsymb = UnwrapElement(IN[1])
booleans = list()

TransactionManager.Instance.EnsureInTransaction(doc)
for item in faminsts:
	try:
		item.RoomTagType = famsymb
		booleans.append(True)
	except:
		booleans.append(False)
TransactionManager.Instance.TransactionTaskDone()

OUT = (faminsts, booleans)
# ----------------------------------------
code_block = CodeBlock(a=python_script) { a[0]; a[1]; }
rt_2 = Output(code_block.out0)  # "rt"
s = Output(code_block.out1)
