# Dynamo custom node v_AllElementsInDocument.dyf (Dynamo 2.3.0.5885)
# category: v-nodes.Revit.Selection

refresh = Input(refresh: bool)
python_script = Python(IN[0]=refresh)
# ---------- python_script.python (15 lines) ----------
author = "Vladyslav M"
url = "https://github.com/vlmarch/dynamo-v-nodes"

import clr
clr.AddReference("RevitAPI")
from Autodesk.Revit.DB import *

clr.AddReference("RevitServices")
from RevitServices.Persistence import DocumentManager

doc = DocumentManager.Instance.CurrentDBDocument

refresh = IN[0]

OUT = FilteredElementCollector(doc).WhereElementIsNotElementType().ToElements()
# ----------------------------------------
Elements = Output(python_script)
