# Dynamo custom node v_AllElementsInView.dyf (Dynamo 2.3.1.11775)
# category: v-nodes.Revit.Views
# Get all elements which are visible in view.

view = Input(view: Revit.Elements.Views.View)
refresh = Input(refresh: bool = true)
python_script = Python(IN[0]=view, IN[1]=refresh)
# ---------- python_script.python (20 lines) ----------
# Load the Python Standard and DesignScript Libraries
import sys
import clr
clr.AddReference('ProtoGeometry')
from Autodesk.DesignScript.Geometry import *

clr.AddReference("RevitAPI")
from Autodesk.Revit.DB import *

clr.AddReference("RevitServices")
from RevitServices.Persistence import DocumentManager

doc = DocumentManager.Instance.CurrentDBDocument

refresh = IN[1]
view_id = UnwrapElement(IN[0]).Id

elems = FilteredElementCollector(doc, view_id).WhereElementIsNotElementType().ToElements()

OUT = elems
# ----------------------------------------
elements = Output(python_script)
