# Dynamo custom node v_Any.dyf (Dynamo 2.3.0.5885)
# category: v-nodes.List.Inspect
# Identifies if any item in an iterable are true.

list = Input(list: var[])
python_script = Python(IN[0]=list)
# ---------- python_script.python (1 lines) ----------
OUT = [any(IN[0]), not all(IN[0])]
# ----------------------------------------
code_block = CodeBlock(a=python_script) { a[0]; a[1]; }
any_true = Output(code_block.out0)
any_false = Output(code_block.out1)
