# Dynamo custom node v_AreaNotPlaced.dyf (Dynamo 2.3.1.11775)
# category: v-nodes.Revit.Area
# Determines the if the given area is not placed.

area = Input(area: Revit.Elements.Element[])
code_block = CodeBlock { "Area"; }
getParameterValueByName = Element.GetParameterValueByName(element=area, parameterName=code_block)
code_block_2 = CodeBlock(area=getParameterValueByName) { area>0; }
isNull = Object.IsNull(obj=code_block_2)
code_block_3 = CodeBlock { false; }
if_ = If(test=isNull, true=code_block_3, false=code_block_2)
filterByBoolMask = List.FilterByBoolMask(list=area, mask=if_)
placed = Output(filterByBoolMask.in)
not_placed = Output(filterByBoolMask.out)
bool = Output(if_)
