# Dynamo custom node v_CleanByData.dyf (Dynamo 2.6.1.8786)
# category: v-nodes.List.Modify
# Clean by data.

element = Input(element: var[]..[])
data = Input(data: var[]..[])
isNull = Object.IsNull(obj=data)
code_block = CodeBlock(a=isNull) { !a; }
filterByBoolMask = List.FilterByBoolMask(list=element, mask=code_block)
clean_element = Output(filterByBoolMask.in)
pure_element = Output(filterByBoolMask.out)
bool = Output(code_block)
