# Dynamo custom node v_ClosestNumber.dyf (Dynamo 2.3.0.5885)
# category: v-nodes.Math
# Finds the closest values in an array of numbers.

numbers = Input(numbers: var[])
number = Input(number: var)
python_script = Python(IN[0]=numbers, IN[1]=number)
# ---------- python_script.python (12 lines) ----------
nums = sorted(IN[0])
n = IN[1]

for i in range(len(nums)):
	if (nums[i] == n) or (nums[i] < n and i == len(nums)-1) or (nums[i] > n and i == 0):
		OUT = [nums[i]] * 3 # closest = closest_upper = closest_lower = nums[i]
	elif nums[i] < n and nums[i+1] > n:
		if n - nums[i] < nums[i+1] - n: closest = nums[i]
		else: closest = nums[i+1]
		closest_upper = nums[i+1]
		closest_lower = nums[i]
		OUT = closest, closest_upper, closest_lower
# ----------------------------------------
code_block = CodeBlock(output=python_script) { output[0]; output[1]; output[2]; }
closest = Output(code_block.out0)
closest_upper = Output(code_block.out1)
closest_lower = Output(code_block.out2)
