# Dynamo custom node v_ColorByName.dyf (Dynamo 2.3.1.11775)
# category: v-nodes.Display
# Gets a color by the name.

color_name = Input(color_name: string[] = ["White"])
python_script = Python(IN[0]=color_name)
# ---------- python_script.python (28 lines) ----------
# Load the Python Standard and DesignScript Libraries
import sys
import urllib
import clr
clr.AddReference('ProtoGeometry')
from Autodesk.DesignScript.Geometry import *

clr.AddReference('DSCoreNodes')
from DSCore import *

color_names = IN[0]

link = "https://raw.githubusercontent.com/codebrainz/color-names/master/output/colors.csv"
f = urllib.urlopen(link)
link_data = f.read().split("\n")
colors_data = [r.replace("\"", "").split(",") for r in link_data][:-1]

output = []
for color_name in color_names:
	color_data = ["white","White","#fff",Color.ByARGB(255,255,255,255)]
	for i,r in enumerate(colors_data):
		if color_name == r[1]:
			color_data = [r[0],r[1],r[2],Color.ByARGB(255,int(r[3]),int(r[4]),int(r[5]))]
			break
		elif color_name in r[1]:
			color_data = [r[0],r[1],r[2],Color.ByARGB(255,int(r[3]),int(r[4]),int(r[5]))]
	output.append(color_data)
OUT = output
# ----------------------------------------
transpose = List.Transpose(lists=python_script)
code_block = CodeBlock(a=transpose) { a[0]; a[1]; a[2]; a[3]; }
color_id = Output(code_block.out0)
color_name_2 = Output(code_block.out1)  # "color_name"
color_hex = Output(code_block.out2)
color = Output(code_block.out3)  # "color: DSCore.Color"
