# Dynamo custom node v_Constrain.dyf (Dynamo 2.3.0.5885)
# category: v-nodes.Math
# Constrains a number to be within a range.

value = Input(value: var)
min_value = Input(min_value: var)
max_value = Input(max_value: var)
python_script = Python(IN[0]=value, IN[1]=min_value, IN[2]=max_value)
# ---------- python_script.python (5 lines) ----------
v = IN[0]
min_v = IN[1]
max_v = IN[2]

OUT = min(max_v, max(min_v, v))
# ----------------------------------------
value_2 = Output(python_script)  # "value"
