# Dynamo custom node v_CreateArea.dyf (Dynamo 2.3.1.11775)
# category: v-nodes.Revit.Area
# Create an Area.

points = Input(points: Autodesk.DesignScript.Geometry.Point[])
area_plan_view = Input(area_plan_view: Revit.Elements.Views.AreaPlanView)  # The view of area element.
python_script = Python(IN[0]=points, IN[1]=area_plan_view)
# ---------- python_script.python (23 lines) ----------
# Load the Python Standard and DesignScript Libraries
import sys
import clr

clr.AddReference("RevitAPI")
from Autodesk.Revit.DB import *

clr.AddReference("RevitServices")
from RevitServices.Persistence import DocumentManager
from RevitServices.Transactions import TransactionManager

clr.AddReference("RevitNodes")
import Revit
clr.ImportExtensions(Revit.GeometryConversion)


doc = DocumentManager.Instance.CurrentDBDocument
pts = [p.ToRevitType() for p in IN[0]]
view = UnwrapElement(IN[1])

TransactionManager.Instance.EnsureInTransaction(doc)
OUT = [doc.Create.NewArea(view, UV(pt.X, pt.Y)) for pt in pts]
TransactionManager.Instance.TransactionTaskDone()
# ----------------------------------------
area = Output(python_script)
