# Dynamo custom node v_CreateAreaBoundaryLine.dyf "v_CreateBoundaryLine" (Dynamo 2.3.1.11775)
# category: v-nodes.Revit.Area
# Create a boundary line.

curves = Input(curves: Autodesk.DesignScript.Geometry.Curve[])
area_plan_view = Input(area_plan_view: Revit.Elements.Views.AreaPlanView)  # The view of boundary line.
python_script = Python(IN[0]=curves, IN[1]=area_plan_view)
# ---------- python_script.python (27 lines) ----------
# Load the Python Standard and DesignScript Libraries
import sys
import clr

clr.AddReference("RevitAPI")
from Autodesk.Revit.DB import *

clr.AddReference("RevitServices")
from RevitServices.Persistence import DocumentManager
from RevitServices.Transactions import TransactionManager

clr.AddReference("RevitNodes")
import Revit
clr.ImportExtensions(Revit.GeometryConversion)


doc = DocumentManager.Instance.CurrentDBDocument
uiapp = DocumentManager.Instance.CurrentUIApplication
app = uiapp.Application

crvs = [c.ToRevitType() for c in IN[0] if c.Length > UnitUtils.ConvertFromInternalUnits(app.ShortCurveTolerance, DisplayUnitType.DUT_CENTIMETERS)]
view = UnwrapElement(IN[1])

TransactionManager.Instance.EnsureInTransaction(doc)
sketch_plane = SketchPlane.Create(doc, view.GenLevel.Id)
OUT = [doc.Create.NewAreaBoundaryLine(sketch_plane, crv, view) for crv in crvs]
TransactionManager.Instance.TransactionTaskDone()
# ----------------------------------------
model_curve = Output(python_script)
