# Dynamo custom node v_CreateMaterialByNameAndColor.dyf (Dynamo 2.3.1.11775)
# category: v-nodes.Revit.Material
# Create a material by the name and color.

name = Input(name: string)
color = Input(color: DSCore.Color)
python_script = Python(IN[0]=name, IN[1]=color)
# ---------- python_script.python (33 lines) ----------
import clr

clr.AddReference("RevitServices")
from RevitServices.Persistence import DocumentManager
from RevitServices.Transactions import TransactionManager

clr.AddReference("RevitAPI")
from Autodesk.Revit.DB import *

doc = DocumentManager.Instance.CurrentDBDocument

name = IN[0]
color = IN[1]

TransactionManager.Instance.EnsureInTransaction(doc)

material = doc.GetElement(Material.Create(doc, name))
material.Color = Color(color.Red, color.Green, color.Blue)
pattern_id = FillPatternElement.GetFillPatternElementByName(doc, FillPatternTarget.Drafting, "<Solid fill>").Id

material.CutBackgroundPatternColor = material.Color
material.CutBackgroundPatternId = pattern_id
material.CutForegroundPatternColor = material.Color
material.CutForegroundPatternId = pattern_id

material.SurfaceBackgroundPatternColor = material.Color
material.SurfaceBackgroundPatternId = pattern_id
material.SurfaceForegroundPatternColor = material.Color
material.SurfaceForegroundPatternId = pattern_id

TransactionManager.Instance.TransactionTaskDone()

OUT = material
# ----------------------------------------
material = Output(python_script)
