# Dynamo custom node v_FilledRegions.dyf (Dynamo 2.3.1.11775)
# category: v-nodes.Revit.Selection
# Get all filled regions.

code_block = CodeBlock { Category.ByName("Detail Items"); }
all_elements_of_category = ElementsOfCategory(Category=code_block)
string_from_object = FromObject(obj=all_elements_of_category)
code_block_2 = CodeBlock(a=string_from_object) { a == "FilledRegion"; }
filterByBoolMask = List.FilterByBoolMask(list=all_elements_of_category, mask=code_block_2)
filled_region = Output(filterByBoolMask.in)
