# Dynamo custom node v_FilterByData.dyf (Dynamo 2.3.0.5885)
# category: v-nodes.List.Modify
# Filter by comparing new and old data.

element = Input(element: var[]..[])
old_data = Input(old_data: var[]..[])
new_data = Input(new_data: var[]..[])
code_block = CodeBlock(old_data=old_data, new_data=new_data) { old_data!=new_data; }
filterByBoolMask = List.FilterByBoolMask(list=element, mask=code_block)
update_element = Output(filterByBoolMask.in)
filterByBoolMask_2 = List.FilterByBoolMask(list=new_data, mask=code_block)
update_data = Output(filterByBoolMask_2.in)
actual_element = Output(filterByBoolMask.out)
actual_data = Output(filterByBoolMask_2.out)
bool = Output(code_block)
