# Dynamo custom node v_Flip.dyf (Dynamo 2.3.1.11775)
# category: v-nodes.Revit.Element
# Flip element.

element = Input(element: var)
flip_facing = Input(flip_facing: bool = false)
flip_hand = Input(flip_hand: bool = false)
python_script = Python(IN[0]=element, IN[1]=flip_facing, IN[2]=flip_hand)
# ---------- python_script.python (35 lines) ----------
import clr
clr.AddReference('RevitAPI')
from Autodesk.Revit.DB import *

clr.AddReference("RevitServices")
import RevitServices
from RevitServices.Persistence import DocumentManager
from RevitServices.Transactions import TransactionManager

doc = DocumentManager.Instance.CurrentDBDocument

elem = UnwrapElement(IN[0])

facing_bool = IN[1]
hand_bool = IN[2]

TransactionManager.Instance.EnsureInTransaction(doc)

if elem.FacingFlipped != facing_bool:	
	try:
		elem.flipFacing()
		ff = True
	except: ff = False
else: ff = True

if elem.HandFlipped != hand_bool:	
	try:
		elem.flipHand()
		hf = True
	except: hf = False
else: hf = True

OUT = elem, all([ff,hf])

TransactionManager.Instance.TransactionTaskDone()
# ----------------------------------------
code_block = CodeBlock(a=python_script) { a[0]; a[1]; }
element_2 = Output(code_block.out0)  # "element"
success = Output(code_block.out1)
