# Dynamo custom node v_FractionPoint.dyf (Dynamo 2.3.1.11775)
# category: v-nodes.Geometry
# Calculate fraction point between two points.

point_1 = Input(point_1: Autodesk.DesignScript.Geometry.Point)
X = Point.X(point=point_1)
point_2 = Input(point_2: Autodesk.DesignScript.Geometry.Point)
X_2 = Point.X(point=point_2)
fraction = Input(fraction: double = 0.5)
Y = Point.Y(point=point_1)
Y_2 = Point.Y(point=point_2)
Z = Point.Z(point=point_1)
Z_2 = Point.Z(point=point_2)
code_block = CodeBlock(x1=X, x2=X_2, p=fraction, y1=Y, y2=Y_2, z1=Z, z2=Z_2) { x1 + (x2 - x1)*p; y1 + (y2 - y1)*p; z1 + (z2 - z1)*p; }
byCoordinates = Point.ByCoordinates(x=code_block.out0, y=code_block.out1, z=code_block.out2)
point = Output(byCoordinates)
