# Dynamo custom node v_GetParameterByName.dyf (Dynamo 2.3.0.5885)
# category: v-nodes.Revit.Parameter

name = Input(name: string[])
python_script = Python(IN[0]=name)
# ---------- python_script.python (31 lines) ----------
author = "Vladyslav M"
url = "https://github.com/vlmarch/dynamo-v-nodes"

import clr
clr.AddReference("RevitServices")
from RevitServices.Persistence import DocumentManager

clr.AddReference("RevitAPI")
from Autodesk.Revit.DB import *

if isinstance(IN[0],list):
	names = UnwrapElement(IN[0])
else:
	names = [UnwrapElement(IN[0])]
	
doc = DocumentManager.Instance.CurrentDBDocument

params = FilteredElementCollector(doc).OfClass(ParameterElement)
ids = []
elems = []

for n in names:
	if n in [p.Name for p in params]:
		[ids.append(p.Id) for p in params if p.Name == n]
		[elems.append(p) for p in params if p.Name == n]
	else:
		ids.append(None)
		elems.append(None)
		

OUT = ids, elems
# ----------------------------------------
code_block = CodeBlock(list=python_script) { list[0]; list[1]; }
id = Output(code_block.out0)
parameter_element = Output(code_block.out1)
