# Dynamo custom node v_IsCurtainWall.dyf (Dynamo 2.3.1.11775)
# category: v-nodes.Revit.Wall
# Identifies if the wall is a curtain wall.

walls = Input(walls: Revit.Elements.Wall[])
python_script = Python(IN[0]=walls)
# ---------- python_script.python (2 lines) ----------
walls = UnwrapElement(IN[0])
OUT = [w.CurtainGrid != None for w in walls]
# ----------------------------------------
bool = Output(python_script)
