# Dynamo custom node v_IsEditable.dyf (Dynamo 2.3.1.11775)
# category: v-nodes.Revit.Worksharing
# Determines if the element not editable.

element = Input(element: Revit.Elements.Element[])
python_script = Python(IN[0]=element)
# ---------- python_script.python (34 lines) ----------
import sys
import clr

clr.AddReference("RevitAPI")
from Autodesk.Revit.DB import *

clr.AddReference("RevitServices")
from RevitServices.Persistence import DocumentManager


doc = DocumentManager.Instance.CurrentDBDocument
app = DocumentManager.Instance.CurrentUIApplication.Application
elems = UnwrapElement(IN[0])

user = app.Username

editable = []
not_editable = []
bool_mask = []

if doc.IsWorkshared:
	for e in elems:
		owner = WorksharingUtils.GetWorksharingTooltipInfo(doc, e.Id).Owner
		if owner == "" or owner == user:
			editable.append(e)
			bool_mask.append(True)
		else:
			not_editable.append(e)
			bool_mask.append(False)
else:
	editable = elems
	bool_mask = [True for i in elems]

OUT = editable, not_editable, bool_mask
# ----------------------------------------
code_block = CodeBlock(a=python_script) { a[0]; a[1]; a[2]; }
editable = Output(code_block.out0)
not_editable = Output(code_block.out1)
bool = Output(code_block.out2)
