# Dynamo custom node v_IsFlipped.dyf (Dynamo 2.3.0.5885)
# category: v-nodes.Revit.Element
# Property to test whether the orientation of family instance is flipped.

element = Input(element: var)
python_script = Python(IN[0]=element)
# ---------- python_script.python (7 lines) ----------
import clr
clr.AddReference('RevitAPI')
from Autodesk.Revit.DB import *

elem = UnwrapElement(IN[0])

OUT = [elem.FacingFlipped, elem.HandFlipped]
# ----------------------------------------
code_block = CodeBlock(a=python_script) { a[0]; a[1]; }
facing_flipped = Output(code_block.out0)
hand_flipped = Output(code_block.out1)
