# Dynamo custom node v_KeynoteFilePath.dyf (Dynamo 2.3.1.11775)
# category: v-nodes.Revit.Document
# Returns Keynote file path.

refresh = Input(refresh: bool = true)
python_script = Python(IN[0]=refresh)
# ---------- python_script.python (14 lines) ----------
import clr
clr.AddReference("RevitAPI")
from Autodesk.Revit.DB import *

clr.AddReference("RevitServices")
from RevitServices.Persistence import DocumentManager

doc = DocumentManager.Instance.CurrentDBDocument

refresh = IN[0]

keynote_reference = KeynoteTable.GetKeynoteTable(doc).GetExternalFileReference()
path = ModelPathUtils.ConvertModelPathToUserVisiblePath(keynote_reference.GetPath())
OUT = path
# ----------------------------------------
path = Output(python_script)
