# Dynamo custom node v_LevelPlane.dyf (Dynamo 2.3.1.11775)
# category: v-nodes.Revit.Level
# Get Level plane.

code_block = CodeBlock { Plane.XY(); }
level = Input(level: Revit.Elements.Level[]..[])
elevation = Level.Elevation(level=level)
offset = Plane.Offset(plane=code_block, dist=elevation)
plane = Output(offset)
