# Dynamo custom node v_OpenDirectory.dyf (Dynamo 2.3.1.11775)
# category: v-nodes.UI
# Open a directory in Windows Explorer.

directory_path = Input(directory_path: string)
open_directory = Input(open_directory: bool = false)
python_script = Python(IN[0]=directory_path, IN[1]=open_directory)
# ---------- python_script.python (5 lines) ----------
import subprocess

path = IN[0]
if IN[1]: subprocess.Popen(r'explorer "{}"'.format(path))
OUT = path
# ----------------------------------------
directory_path_2 = Output(python_script)  # "directory_path"
