# Dynamo custom node v_OpenURL.dyf (Dynamo 2.3.1.11775)
# category: v-nodes.UI
# Open Url in default web browser.

url = Input(url: string)
open_url = Input(open_url: bool = false)
python_script = Python(IN[0]=url, IN[1]=open_url)
# ---------- python_script.python (5 lines) ----------
import webbrowser

url = IN[0]
if IN[1]: webbrowser.open(url)
OUT = url
# ----------------------------------------
url_2 = Output(python_script)  # "url"
