# Dynamo custom node v_PointCoordinates.dyf (Dynamo 2.3.1.11775)
# category: v-nodes.Geometry
# Return point coordinates as a list.

point = Input(point: Autodesk.DesignScript.Geometry.Point[])
X = Point.X(point=point)
Y = Point.Y(point=point)
Z = Point.Z(point=point)
code_block = CodeBlock(x=X, y=Y, z=Z) { [x,y,z]; }
transpose = Input(transpose: bool = false)
python_script = Python(IN[0]=code_block, IN[1]=transpose)
# ---------- python_script.python (10 lines) ----------
import sys
import clr
clr.AddReference('DSCoreNodes')
from DSCore import *

data = IN[0]
transpose = IN[1]

if transpose: OUT = data
else: OUT = List.Transpose(data)
# ----------------------------------------
coordinates = Output(python_script)
