# Dynamo custom node v_PointsEquality.dyf (Dynamo 2.3.1.11775)
# category: v-nodes.Geometry
# Determines point equality.

point_1 = Input(point_1: Autodesk.DesignScript.Geometry.Point[]..[])
X = Point.X(point=point_1)
point_2 = Input(point_2: Autodesk.DesignScript.Geometry.Point[]..[])
X_2 = Point.X(point=point_2)
Y = Point.Y(point=point_1)
Y_2 = Point.Y(point=point_2)
Z = Point.Z(point=point_1)
Z_2 = Point.Z(point=point_2)
code_block = CodeBlock(x1=X, x2=X_2, y1=Y, y2=Y_2, z1=Z, z2=Z_2)
# ---------- code_block.designscript (5 lines) ----------
x1 == x2
&&
y1 == y2
&&
z1 == z2;
# ----------------------------------------
bool = Output(code_block)
