# Dynamo custom node v_PolygonArea.dyf (Dynamo 2.3.1.11775)
# category: v-nodes.Geometry
# Calculate area of a polygon.

polygon = Input(polygon: Autodesk.DesignScript.Geometry.Polygon)
python_script = Python(IN[0]=polygon)
# ---------- python_script.python (22 lines) ----------
import sys
import clr
clr.AddReference('ProtoGeometry')
from Autodesk.DesignScript.Geometry import *

clr.AddReference('DSCoreNodes')
from DSCore import *

poligon = IN[0]

if poligon.IsPlanar:
	cs1 = CoordinateSystem.ByPlane(poligon.BasePlane())
	cs2 = CoordinateSystem.ByPlane(Plane.XY())
	poligon = Geometry.Transform(poligon, cs1, cs2)
	pol_pts = [p for p in poligon.Points]
	area = 0
	for i in range(len(pol_pts)):
		area += pol_pts[i-1].X * pol_pts[i].Y
		area -= pol_pts[i-1].Y * pol_pts[i].X
	OUT = abs(area)/2 
else: 
	OUT = None
# ----------------------------------------
area = Output(python_script)  # "area: double"
