# Dynamo custom node v_PolygonOffset.dyf (Dynamo 2.3.1.11775)
# category: v-nodes.Geometry
# Offset a Polygon by a specified amount. Polygon must be planar.

polygon = Input(polygon: Autodesk.DesignScript.Geometry.Polygon)
distance = Input(distance: double = 1)  # A positive or negative distance to offset
python_script = Python(IN[0]=polygon, IN[1]=distance)
# ---------- python_script.python (23 lines) ----------
import sys
import clr
clr.AddReference('ProtoGeometry')
from Autodesk.DesignScript.Geometry import *

clr.AddReference('DSCoreNodes')
from DSCore import *

poligon = IN[0]
distance = IN[1]
pol_pts = [p for p in poligon.Points]

if poligon.IsPlanar:
	new_pts = []
	for i in range(len(pol_pts)):
		v1 = Vector.ByTwoPoints(pol_pts[i-1], pol_pts[i]).Normalized().Rotate(poligon.Normal ,-90)
		v2 = Vector.ByTwoPoints(pol_pts[i-2], pol_pts[i-1]).Normalized().Rotate(poligon.Normal ,-90)
		vec = Vector.Add(v1,v2).Normalized().Scale(distance / Math.Cos(Vector.AngleWithVector(v1,v2)/2))
		new_pts.append(Geometry.Translate(pol_pts[i-1], vec))
	new_pts.append(new_pts.pop(0))
	OUT = Polygon.ByPoints(new_pts)
else: 
	OUT = None
# ----------------------------------------
polygon_2 = Output(python_script)  # "polygon: Autodesk.DesignScript.Geometry.Polygon"
