# Dynamo custom node v_PythonBoilerplate.dyf (Dynamo 2.3.0.5885)
# category: v-nodes.About

run_it = Input(run_it: bool = false)
show_form = Input(show_form: bool = false)
python_script = Python(IN[0]=run_it, IN[1]=show_form)
# ---------- python_script.python (36 lines) ----------
author = "Vladyslav M"
url = "https://github.com/vlmarch/dynamo-v-nodes"

import clr
import urllib

clr.AddReference('System.Windows.Forms')
clr.AddReference('System.Drawing')
from System.Windows import *
from System.Drawing import Point, Size
from System.Windows.Forms import Application, Form, RichTextBox

class TextBoxForm(Form):
	def __init__(self, msg):
		self.Name = "Python boilerplate"
		self.Text = "Python boilerplate"
		self.Size = Size(500, 700)
        
		self.textbox = RichTextBox()
		self.textbox.Text=str(msg)
		self.textbox.Location = Point(0,0)
		self.textbox.Size = self.Size
		
		self.Controls.Add(self.textbox)         

if IN[0] == True:
	url = "https://raw.githubusercontent.com/vlmarch/revit-python-boilerplate/main/PythonTemplate.py"
	f = urllib.urlopen(url)
	boilerplate = f.read()
	if IN[1] == True:
		form = TextBoxForm(boilerplate)
		Application.Run(form)
	
	OUT = boilerplate
else:
	OUT = "Pause"
# ----------------------------------------
boilerplate = Output(python_script)
