# Dynamo custom node v_Question.dyf (Dynamo 2.3.1.11775)
# category: v-nodes.UI
# Dialog box that can be used to receive simple input from the user.

title = Input(title: string = "v_nodes")  # Title of the task dialog.
msg = Input(msg: string)  # The large primary text that appears at the top of a task dialog.
content = Input(content: string = null)  # The smaller text that appears just below the main instructions.
footer_text = Input(footer_text: string = null)  # The text in the footer area of the task dialog.
refresh = Input(refresh: bool = true)
python_script = Python(IN[0]=title, IN[1]=msg, IN[2]=content, IN[3]=footer_text, IN[4]=refresh)
# ---------- python_script.python (20 lines) ----------
import clr
clr.AddReference("RevitAPIUI")
from Autodesk.Revit.UI import *

def dialog_bool(msg, title = "v_nodes", content = None, footer_text = None):
    task_dialog = TaskDialog(title)
    task_dialog.MainInstruction = msg
    if content: task_dialog.MainContent = content
    if footer_text: task_dialog.FooterText = footer_text
    task_dialog.CommonButtons = TaskDialogCommonButtons.No | TaskDialogCommonButtons.Yes
    answer = task_dialog.Show()
    if answer.ToString() == "Yes": return True
    else: return False

title = IN[0]
msg = IN[1]
content = IN[2]
footer_text = IN[3]
refresh = IN[4]
OUT = dialog_bool(msg, title, content, footer_text)
# ----------------------------------------
answer = Output(python_script)  # "answer: bool"
