# Dynamo custom node v_RelativeDifference.dyf (Dynamo 2.3.0.5885)
# category: v-nodes.Math

numbers = Input(numbers: var[])
python_script = Python(IN[0]=numbers)
# ---------- python_script.python (10 lines) ----------
author = "Vladyslav M"
url = "https://github.com/vlmarch"

if isinstance(IN[0],list):
	num = UnwrapElement(IN[0])
else:
	num = [UnwrapElement(IN[0])]


OUT = [0] + [num[i] - num[i-1] for i in range(1,len(num))]
# ----------------------------------------
numbers_2 = Output(python_script)  # "numbers"
