# Dynamo custom node v_ReplaceType.dyf (Dynamo 2.3.1.11775)
# category: v-nodes.Revit.Element
# Replace Family type.

elements = Input(elements: Revit.Elements.Element[])
family_type = Input(family_type: Revit.Elements.FamilyType)
python_script = Python(IN[0]=elements, IN[1]=family_type)
# ---------- python_script.python (16 lines) ----------
import clr

clr.AddReference("RevitServices")
from RevitServices.Persistence import DocumentManager

doc = DocumentManager.Instance.CurrentDBDocument

elem = UnwrapElement(IN[0])
new_type = UnwrapElement(IN[1])

for e in elem:
	e_type = e.LookupParameter("Type").AsElementId()
	if e_type != new_type:
		e.LookupParameter("Type").Set(new_type.Id)

OUT = elem
# ----------------------------------------
elements_2 = Output(python_script)  # "elements"
