# Dynamo custom node v_RevitUsername.dyf (Dynamo 2.3.1.11775)
# category: v-nodes.Revit.Worksharing
# Returns the username.

python_script = Python()  # unwired: IN[0]
# ---------- python_script.python (9 lines) ----------
import sys
import clr

clr.AddReference("RevitServices")
from RevitServices.Persistence import DocumentManager

app = DocumentManager.Instance.CurrentUIApplication.Application

OUT = app.Username
# ----------------------------------------
revit_username = Output(python_script)
