# Dynamo custom node v_RoomBoundaries_test.dyf (Dynamo 2.3.1.11775)
# category: v-nodes.Revit.Room

room = Input(room: Revit.Elements.Room)
remove_nulls = Input(remove_nulls: bool = false)
python_script = Python(IN[0]=room, IN[1]=remove_nulls)
# ---------- python_script.python (28 lines) ----------
import clr
clr.AddReference('RevitAPI')
from Autodesk.Revit.DB import *

clr.AddReference('RevitServices')
from RevitServices.Persistence import DocumentManager
doc = DocumentManager.Instance.CurrentDBDocument

clr.AddReference("RevitNodes")
import Revit
clr.ImportExtensions(Revit.GeometryConversion)

elems = []
crvs = []

room = UnwrapElement(IN[0])
remove_nulls = IN[1]

for segment in room.GetBoundarySegments(SpatialElementBoundaryOptions()):
	for s in segment:
		elem = doc.GetElement(s.ElementId)
		crv = s.GetCurve().ToProtoType()
		if elem is None and remove_nulls: pass
		else:
			elems.append(elem)
			crvs.append(crv)
			
OUT = elems, crvs
# ----------------------------------------
code_block = CodeBlock(a=python_script) { a[0]; a[1]; }
boundarys = Output(code_block.out0)
curves = Output(code_block.out1)
