# Dynamo custom node v_RoomLevel.dyf (Dynamo 2.3.1.11775)
# category: v-nodes.Revit.Room
# Get room level.

rooms = Input(rooms: Revit.Elements.Room[])
python_script = Python(IN[0]=rooms)
# ---------- python_script.python (1 lines) ----------
OUT = [e.Level for e in UnwrapElement(IN[0])]
# ----------------------------------------
levels = Output(python_script)
