# Dynamo custom node v_RoomNotPlaced.dyf (Dynamo 2.3.1.11775)
# category: v-nodes.Revit.Room
# Determines the if the given room is not placed.

rooms = Input(rooms: Revit.Elements.Room[]..[])
area = Room.Area(room=rooms)
code_block = CodeBlock(area=area) { area>0; }
filterByBoolMask = List.FilterByBoolMask(list=rooms, mask=code_block)
placed = Output(filterByBoolMask.in)
not_placed = Output(filterByBoolMask.out)
bool = Output(code_block)
