# Dynamo custom node v_SheetSchedules.dyf (Dynamo 2.3.1.11775)
# category: v-nodes.Revit.Sheet
# Get all schedules on the sheet.

sheet = Input(sheet: Revit.Elements.Views.Sheet)
python_script = Python(IN[0]=sheet)
# ---------- python_script.python (18 lines) ----------
# Load the Python Standard and DesignScript Libraries
import sys
import clr
clr.AddReference('ProtoGeometry')
from Autodesk.DesignScript.Geometry import *

clr.AddReference("RevitAPI")
from Autodesk.Revit.DB import *

clr.AddReference("RevitServices")
from RevitServices.Persistence import DocumentManager

doc = DocumentManager.Instance.CurrentDBDocument

sheet_id = UnwrapElement(IN[0]).Id.IntegerValue
schedule_sheet_ins = FilteredElementCollector(doc).OfClass(ScheduleSheetInstance).WhereElementIsNotElementType().ToElements()

OUT = [doc.GetElement(s.ScheduleId) for s in schedule_sheet_ins if s.OwnerViewId.IntegerValue == sheet_id]
# ----------------------------------------
schedules = Output(python_script)
