# Dynamo custom node v_SheetTitleblock.dyf (Dynamo 2.3.1.11775)
# category: v-nodes.Revit.Sheet
# Get all titleblocks at the sheet.

sheet = Input(sheet: Revit.Elements.Views.Sheet)
python_script = Python(IN[0]=sheet)
# ---------- python_script.python (17 lines) ----------
import sys
import clr
clr.AddReference('ProtoGeometry')
from Autodesk.DesignScript.Geometry import *

clr.AddReference("RevitAPI")
from Autodesk.Revit.DB import *

clr.AddReference("RevitServices")
from RevitServices.Persistence import DocumentManager

sheet = UnwrapElement(IN[0])

doc = DocumentManager.Instance.CurrentDBDocument

titleblocks_ids = sheet.GetDependentElements(ElementCategoryFilter(BuiltInCategory.OST_TitleBlocks))
OUT = [doc.GetElement(id) for id in title_blocks_ids]
# ----------------------------------------
titleblocks = Output(python_script)
