# Dynamo custom node v_SheetViews.dyf (Dynamo 2.3.1.11775)
# category: v-nodes.Revit.Sheet
# Get all views on the sheet.

sheet = Input(sheet: Revit.Elements.Views.Sheet)
python_script = Python(IN[0]=sheet)
# ---------- python_script.python (14 lines) ----------
# Load the Python Standard and DesignScript Libraries
import sys
import clr
clr.AddReference('ProtoGeometry')
from Autodesk.DesignScript.Geometry import *

clr.AddReference("RevitServices")
from RevitServices.Persistence import DocumentManager

doc = DocumentManager.Instance.CurrentDBDocument

sheet = UnwrapElement(IN[0])

OUT = [doc.GetElement(doc.GetElement(v_id).ViewId) for v_id in sheet.GetAllViewports()]
# ----------------------------------------
views = Output(python_script)
