# Dynamo custom node v_SimplifyPolygon.dyf (Dynamo 2.3.1.11775)
# category: v-nodes.Geometry
# Returns a new polygon approximated with tolerance.

polygon = Input(polygon: Autodesk.DesignScript.Geometry.Polygon)
tolerance = Input(tolerance: double = 0)
python_script = Python(IN[0]=polygon, IN[1]=tolerance)
# ---------- python_script.python (26 lines) ----------
# Load the Python Standard and DesignScript Libraries
import sys
import clr
clr.AddReference('ProtoGeometry')
from Autodesk.DesignScript.Geometry import *

poligon = IN[0]
pol_pts = [p for p in poligon.Points]
tolerance = IN[1]

pts_vec = [Vector.ByTwoPoints(pol_pts[i-1], pol_pts[i]).Normalized() for i in range(len(pol_pts))]
pts_vec.append(pts_vec.pop(0))

a = Vector.AngleBetween(pts_vec[-1], pts_vec[0])

while Vector.AngleBetween(pts_vec[-1], pts_vec[0]) <= tolerance:
	pol_pts.append(pol_pts.pop(0))
	pts_vec.append(pts_vec.pop(0))
	a = Vector.AngleBetween(pts_vec[-1], pts_vec[0])

new_pts = []
for i, pt in enumerate(pol_pts):
	if Vector.AngleBetween(pts_vec[i-1], pts_vec[i]) > tolerance:
		new_pts.append(pt)

OUT = Polygon.ByPoints(new_pts)
# ----------------------------------------
polygon_2 = Output(python_script)  # "polygon: Autodesk.DesignScript.Geometry.Polygon"
