# Dynamo custom node v_SortViews.dyf (Dynamo 2.3.1.11775)
# category: v-nodes.Revit.Views
# Sort views based on its types.

views = Input(views: var[])
isNull = Object.IsNull(obj=views)
filterByBoolMask = List.FilterByBoolMask(list=views, mask=isNull)
python_script = Python(IN[0]=filterByBoolMask.out)
# ---------- python_script.python (17 lines) ----------
# Load the Python Standard and DesignScript Libraries
import sys
import clr
clr.AddReference('ProtoGeometry')
from Autodesk.DesignScript.Geometry import *

views = UnwrapElement(IN[0])

sorted_views = {}
for v in views:
	v_type = v.ViewType.ToString()
	if v_type in sorted_views:
		sorted_views[v_type].append(v)
	else:
		sorted_views[v_type] = [v]

OUT = sorted_views, sorted_views.keys(), sorted_views.values()
# ----------------------------------------
code_block = CodeBlock(a=python_script) { a[0]; a[1]; a[2]; }
dictionary = Output(code_block.out0)
keys = Output(code_block.out1)
views_2 = Output(code_block.out2)  # "views"
