# Dynamo custom node v_TagPoints.dyf (Dynamo 2.3.1.11775)
# category: v-nodes.Revit.Tag
# Get tag points.

tag = Input(tag: Revit.Elements.Element)
python_script = Python(IN[0]=tag)
# ---------- python_script.python (34 lines) ----------
import clr
clr.AddReference("RevitAPI")
from Autodesk.Revit.DB import *

clr.AddReference("RevitNodes")
import Revit
clr.ImportExtensions(Revit.GeometryConversion)

tag = UnwrapElement(IN[0])

if tag.Location.GetType() == LocationPoint:
	tag_location = tag.Location.Point.ToPoint()
else:
	tag_location = None
	
tag_head_position = tag.TagHeadPosition.ToPoint()

tag_type = tag.GetType()
if tag.HasLeader:
	if tag_type == Architecture.RoomTag or tag_type == AreaTag or tag_type == Mechanical.SpaceTag:
		tag_leader_end = tag.LeaderEnd.ToPoint()
	elif tag.LeaderEndCondition == LeaderEndCondition.Free:
		tag_leader_end = tag.LeaderEnd.ToPoint()
	else:
		tag_leader_end = None
else:
	tag_leader_end = None

if tag.HasLeader and tag.HasElbow:
	tag_leader_elbow = tag.LeaderElbow.ToPoint()
else:
	tag_leader_elbow = None

OUT = tag_location, tag_head_position, tag_leader_end, tag_leader_elbow
# ----------------------------------------
code_block = CodeBlock(pts=python_script) { tag_location = pts[0]; tag_head_position = pts[1]; tag_leader_end = pts[2]; tag_leader_elbow = pts[3]; }
tag_location = Output(code_block.tag_location)
tag_head_position = Output(code_block.tag_head_position)
tag_leader_end = Output(code_block.tag_leader_end)
tag_leader_elbow = Output(code_block.tag_leader_elbow)
