# Dynamo custom node v_VectorByPoint.dyf (Dynamo 2.3.1.11775)
# category: v-nodes.Geometry
# Form a Vector by point.

point = Input(point: Autodesk.DesignScript.Geometry.Point)  # Point
X = Point.X(point=point)
Y = Point.Y(point=point)
Z = Point.Z(point=point)
byCoordinates = Vector.ByCoordinates(x=X, y=Y, z=Z)
vector = Output(byCoordinates)  # "vector: Autodesk.DesignScript.Geometry.Vector"
