# Dynamo custom node v_ViewAssociatedLevel.dyf (Dynamo 2.3.0.5885)
# category: v-nodes.Revit.Views

code_block = CodeBlock { "Associated Level"; Category.ByName("Levels"); }
all_elements_of_category = ElementsOfCategory(Category=code_block.out1)
name = Level.Name(level=all_elements_of_category)
byKeysValues = DesignScript.Builtin.Dictionary.ByKeysValues(keys=name, values=all_elements_of_category)
view = Input(view: var[]..[])
getParameterValueByName = Element.GetParameterValueByName(element=view, parameterName=code_block.out0)
valueAtKey = DesignScript.Builtin.Dictionary.ValueAtKey(dictionary=byKeysValues, key=getParameterValueByName)
level = Output(valueAtKey)
