# Dynamo custom node v_ViewCropShape.dyf (Dynamo 2.3.1.11775)
# category: v-nodes.Revit.Views
# Gets the view crop boundaries.

view = Input(view: Revit.Elements.Views.View)
python_script = Python(IN[0]=view)
# ---------- python_script.python (19 lines) ----------
import clr
clr.AddReference('ProtoGeometry')
from Autodesk.DesignScript.Geometry import *

clr.AddReference("RevitAPI")
from Autodesk.Revit.DB import *

clr.AddReference("RevitNodes")
import Revit
clr.ImportExtensions(Revit.GeometryConversion)


view = UnwrapElement(IN[0])

boundary = view.GetCropRegionShapeManager().GetCropShape()
if len(boundary) > 0:
	OUT = [l.ToProtoType() for l in boundary[0]]
else:
	OUT = None
# ----------------------------------------
crop_shape = Output(python_script)
