# Dynamo custom node v_ViewHideElements.dyf (Dynamo 2.3.1.11775)
# category: v-nodes.Revit.Views
# Sets the elements to be hidden in the view.

view = Input(view: Revit.Elements.Views.View)
elements = Input(elements: Revit.Elements.Element[])
python_script = Python(IN[0]=view, IN[1]=elements)
# ---------- python_script.python (24 lines) ----------
import clr
clr.AddReference("RevitAPI")
from Autodesk.Revit.DB import *

clr.AddReference("RevitServices")
from RevitServices.Persistence import DocumentManager
from RevitServices.Transactions import TransactionManager

clr.AddReference("System")
from System.Collections.Generic import List


view = UnwrapElement(IN[0])
elems_ids = List[ElementId]([e.Id for e in UnwrapElement(IN[1])])

doc = DocumentManager.Instance.CurrentDBDocument

TransactionManager.Instance.EnsureInTransaction(doc)
try:
	view.HideElements(elems_ids)
	OUT = True
except:
	OUT = False
TransactionManager.Instance.TransactionTaskDone()
# ----------------------------------------
bool = Output(python_script)
