# Dynamo custom node v_ViewScopeBox.dyf (Dynamo 2.3.1.11775)
# category: v-nodes.Revit.Views
# The scope box for the view.

view = Input(view: Revit.Elements.Views.View)
code_block = CodeBlock { "Scope Box"; }
getParameterValueByName = Element.GetParameterValueByName(element=view, parameterName=code_block)
scope_box = Output(getParameterValueByName)
