# Dynamo custom node v_WallProfile.dyf (Dynamo 2.3.1.11775)
# category: v-nodes.Revit.Wall
# Wall Profile

wall = Input(wall: Revit.Elements.Wall)
exterior = Input(exterior: bool = true)  # True - Exterior; False - Interior
python_script = Python(IN[0]=wall, IN[1]=exterior)
# ---------- python_script.python (33 lines) ----------
import clr
clr.AddReference("RevitAPI")
from Autodesk.Revit.DB import *

clr.AddReference("RevitServices")
from RevitServices.Persistence import DocumentManager

clr.AddReference("RevitNodes")
import Revit
clr.ImportExtensions(Revit.Elements)
clr.ImportExtensions(Revit.GeometryConversion)


wall = UnwrapElement(IN[0])
exterior = IN[1]

if exterior:
	slt = ShellLayerType.Exterior
else:
	slt = ShellLayerType.Interior

reference = HostObjectUtils.GetSideFaces(wall, slt)[0]
face = wall.GetGeometryObjectFromReference(reference)
normal = face.ComputeNormal(UV(.5,.5))
curve_loops = face.GetEdgesAsCurveLoops()

wall_curve_loops = []
for cl in curve_loops:
	if not cl.IsCounterclockwise(normal):
		cl.Flip()
	wall_curve_loops.append([c.ToProtoType() for c in cl])
	
OUT = wall_curve_loops, normal.ToVector()
# ----------------------------------------
code_block = CodeBlock(data=python_script) { wall_curve_loops = data[0]; normal = data[1]; }
wall_curve_loops = Output(code_block.wall_curve_loops)
normal = Output(code_block.normal)
