# Dynamo custom node v_WatchInNotepad.dyf (Dynamo 2.3.0.5885)
# category: v-nodes.UI

code_block = CodeBlock { "\n"; }
data = Input(data: var[]..[])
string_from_object = FromObject(obj=data)
flatten = List.Flatten(list=string_from_object)
join = String.Join(separator=code_block, string0=flatten)
code_block_2 = CodeBlock(a=join) { a[0]; }
notepad = Input(notepad: bool = true)  # true - notepad false - vs code
run_it = Input(run_it: bool = true)
python_script = Python(IN[0]=code_block_2, IN[1]=notepad, IN[2]=run_it)
# ---------- python_script.python (22 lines) ----------
import os
import uuid

desktop = os.path.join(os.path.join(os.environ['USERPROFILE']), 'Desktop')
file_path = desktop + "\\" + str(uuid.uuid4()) + ".txt"

data = IN[0]
notepad = IN[1]
run_it = IN[2]

if run_it:
	with open(file_path, "w") as f:
		f.write(data.encode("utf-8")) 
	
	if notepad:
		os.system('Notepad "{}" && cls'.format(file_path))
	else:
		os.system('code "{}" && cls'.format(file_path))
		import time
		time.sleep(2)
	os.remove(file_path)
OUT = None
# ----------------------------------------
data_2 = Output(data)  # "data"
