# Dynamo custom node v_WorksharingTooltipInfo.dyf (Dynamo 2.3.1.11775)
# category: v-nodes.Revit.Worksharing
# Return worksharing information about an element.

element = Input(element: Revit.Elements.Element)
python_script = Python(IN[0]=element)
# ---------- python_script.python (19 lines) ----------
import sys
import clr

clr.AddReference("RevitAPI")
from Autodesk.Revit.DB import *

clr.AddReference("RevitServices")
import RevitServices
from RevitServices.Persistence import DocumentManager
from RevitServices.Transactions import TransactionManager

doc = DocumentManager.Instance.CurrentDBDocument
elem = UnwrapElement(IN[0])

if doc.IsWorkshared:
	worksharing_tooltip_info = WorksharingUtils.GetWorksharingTooltipInfo(doc, elem.Id)
	OUT = worksharing_tooltip_info.Creator, worksharing_tooltip_info.Owner, worksharing_tooltip_info.LastChangedBy
else:
	OUT = None, None, None
# ----------------------------------------
code_block = CodeBlock(a=python_script) { a[0]; a[1]; a[2]; }
creator = Output(code_block.out0)
owner = Output(code_block.out1)
last_changed_by = Output(code_block.out2)
