# Dynamo custom node v_zfill.dyf (Dynamo 2.3.1.11775)
# category: v-nodes.String.Modify
# Return a copy of the string left filled with ASCII '0' digits to make a string of length width.

str = Input(str: string)
len = Input(len: int = 2)  # A number specifying the desired length of the string
python_script = Python(IN[0]=str, IN[1]=len)
# ---------- python_script.python (4 lines) ----------
data = IN[0]
width = IN[1]

OUT = data.zfill(width)
# ----------------------------------------
str_2 = Output(python_script)  # "str"
